# Dynamo graph Calculate Occupancy Load v1.2.1.dyn (Dynamo 1.2.1.3083)

# group: DESIGN
# note: ________________________________________________________
# FOR BACK-END FUNCTIONALITY

# group: INPUT
# note: ________________________________________________________
# FOR INCOMMING REFFERENCES
# (FILE PATHS, GEOMETRIES...)

# group: CONTROL
# note: ________________________________________________________
# FOR USER INPUT (SUCH AS SLIDERS,
#  NUMBERS, ....)

# group: GOOD PRACTICE GUIDELINES
# note: _______________________________________________________
# 1. DIVIDE THE SCRIPT INTO THE USER INTERFACE AND THE BACK-END
# 2. BUILD THE SCRIPT WITH SMALL GROUPS OF NODES
# 3. GROUPS SHOULD ALWAYS HAVE INPUT/OUTPUT
# 4. RENAME INPUT/OUTPUT CONTAINERS TO DATA THEY CARRY
# 5. COLOR-CODE GROUPS ACCORDING TO THE CATEGORIES IN THE TEMPLATE

# group: OUTPUT
# note: ________________________________________________________
# FOR BLOCKS THAT EXPORT GEOMETRY AND DATA TO EXTERNAL PROGRAMS (INCLUDING REVIT)

# group: MONITOR
# note: ________________________________________________________
# FOR IMPORTANT WATCH NODES

# group: WIP
# note: ________________________________________________________
# FOR "WORK IN PROGRESS"

# group: ANNOTATION
# note: ________________________________________________________
# FOR COMMENTS

# group: Calculate Occupancy Load
# note: SUPPORT
# Dynamo version: 1.2.1
# Required Packages: Lunchbox
# Last Update: 2016.12.8
# Author: Luc Deckinga
# note: INSTRUCTIONS
# Select whether you want the script to calculate occupancy from Areas or Rooms.
# Input the names of the Factor and Load parameters you are using in the Revit file. The P+W standard parameter names are input to start.
# Run the script.
# The occupancy will be rounded up to the nearest whole number of occupants. (e.g. 7.45 -> 8)
# There is an Area Tag included with this script that uses the default P+W parameters.

# group: Select whether you want to perform the calculations on Areas or Rooms.
categories = Categories("Areas")

# group: The occupant load is caluclated using the following formula: Load = RoundUp(Area / Factor) The two String nodes below are the names of the Factor and Load parameters. The values have been pre-populated with the standard P+W parameters that can be found in the firmwide shared parameter file.
string = StringInput("AR_OccupantLoadFactorTagged_PW")
string_2 = StringInput("AR_OccupantLoadTagged_PW")

# group: Main Code Block
all_elements_of_category = ElementsOfCategory(categories)
lunchbox_get_parameter_value = Custom[LunchBox Get Parameter Value](Element=all_elements_of_category, ParamName=string)  # Gets parameter values from a Revit element.
code_block = CodeBlock { 1; }
flatten = List.Flatten(list=lunchbox_get_parameter_value, amt=code_block)
string_3 = StringInput(" ")
split = String.Split(flatten, string_3)
transpose = List.Transpose(split)
firstItem = List.FirstItem(transpose)
toNumber = String.ToNumber(firstItem)
code_block_2 = CodeBlock { 0; }
eq = toNumber == code_block_2
filterByBoolMask = List.FilterByBoolMask(list=all_elements_of_category, mask=eq)
string_4 = StringInput("Area")
lunchbox_get_parameter_value_2 = Custom[LunchBox Get Parameter Value](Element=all_elements_of_category, ParamName=string_4)
flatten_2 = List.Flatten(list=lunchbox_get_parameter_value_2, amt=code_block)
string_from_object = FromObject(flatten_2)
split_2 = String.Split(string_from_object, string_3)
transpose_2 = List.Transpose(split_2)
firstItem_2 = List.FirstItem(transpose_2)
toNumber_2 = String.ToNumber(firstItem_2)
filterByBoolMask_2 = List.FilterByBoolMask(list=toNumber_2, mask=eq)
filterByBoolMask_3 = List.FilterByBoolMask(list=toNumber, mask=eq)
div = filterByBoolMask_2.out / filterByBoolMask_3.out
ceiling = Math.Ceiling(div)
setParameterByName = Element.SetParameterByName(element=filterByBoolMask.out, parameterName=string_2, value=ceiling)
