# Dynamo graph Calculate Occupancy Load.dyn (Dynamo 1.2.1.3083)

# group: DESIGN
# note: ________________________________________________________
# FOR BACK-END FUNCTIONALITY

# group: INPUT
# note: ________________________________________________________
# FOR INCOMMING REFFERENCES
# (FILE PATHS, GEOMETRIES...)

# group: CONTROL
# note: ________________________________________________________
# FOR USER INPUT (SUCH AS SLIDERS,
#  NUMBERS, ....)

# group: GOOD PRACTICE GUIDELINES
# note: _______________________________________________________
# 1. DIVIDE THE SCRIPT INTO THE USER INTERFACE AND THE BACK-END
# 2. BUILD THE SCRIPT WITH SMALL GROUPS OF NODES
# 3. GROUPS SHOULD ALWAYS HAVE INPUT/OUTPUT
# 4. RENAME INPUT/OUTPUT CONTAINERS TO DATA THEY CARRY
# 5. COLOR-CODE GROUPS ACCORDING TO THE CATEGORIES IN THE TEMPLATE

# group: OUTPUT
# note: ________________________________________________________
# FOR BLOCKS THAT EXPORT GEOMETRY AND DATA TO EXTERNAL PROGRAMS (INCLUDING REVIT)

# group: MONITOR
# note: ________________________________________________________
# FOR IMPORTANT WATCH NODES

# group: WIP
# note: ________________________________________________________
# FOR "WORK IN PROGRESS"

# group: ANNOTATION
# note: ________________________________________________________
# FOR COMMENTS

# group: Calculate Occupancy Load
# note: SUPPORT
# Dynamo version: 1.2.1
# Required Packages: Lunchbox
# Last Update: 2016.12.8
# Author: Luc Deckinga
# note: INSTRUCTIONS
# Select whether you want the script to calculate occupancy from Areas or Rooms.
# Input the names of the Factor and Load parameters you are using in the Revit file. The P+W standard parameter names are input to start.
# Run the script.
# The occupancy will be rounded up to the nearest whole number of occupants. (e.g. 7.45 -> 8)
# There is an Area Tag included with this script that uses the default P+W parameters.

# group: Select whether you want to perform the calculations on Areas or Rooms.
categories = Categories("Areas")
occupant_load_parameter_name = StringInput("AR_OccupantLoadTagged_PW")

# group: Get Areas from Revit
all_elements_of_category = ElementsOfCategory(categories)

string = StringInput("Area")
getParameterValueByName = Element.GetParameterValueByName(element=all_elements_of_category, parameterName=string)

# group: The occupant load is caluclated using the following formula: Load = RoundUp(Area / Factor) The two String nodes below are the names of the Factor and Load parameters. The values have been pre-populated with the standard P+W parameters that can be found in the firmwide shared parameter file.
load_factor_parameter_name = StringInput("AR_OccupantLoadFactorTagged_PW")

getParameterValueByName_2 = Element.GetParameterValueByName(element=all_elements_of_category, parameterName=load_factor_parameter_name)

# group: Calculation
div = getParameterValueByName / getParameterValueByName_2
ceiling = Math.Ceiling(div)

# group: Push Occupant Count to Revit Parameter
setParameterByName = Element.SetParameterByName(element=all_elements_of_category, parameterName=occupant_load_parameter_name, value=ceiling)  # frozen
